# Grasshopper definition GHLoftingRects.gh (Grasshopper 1.0.7)

# ---- group: Top Rect
Z = UnitZ(Factor=Slider(37, range=0..100))
xy = XYPlane(Origin=Z)
rectangle = Rectangle(Plane=xy, XSize=Slider(8, range=0..100), YSize=Slider(51, range=0..100), Radius=Slider(0, range=0..100))  # -> Rectangle, Length

# ---- group: Middle Rect
number_slider = Slider(2, range=0..20)
Z_2 = UnitZ(Factor=Slider(20, range=0..20))
xy_2 = XYPlane(Origin=Z_2)
rectangle_2 = Rectangle(Plane=xy_2, XSize=Slider(26, range=0..100), YSize=Slider(2, range=0..100), Radius=Slider(7, range=0..100))  # -> Rectangle, Length

# ---- group: Bottom Rect
xy_3 = XYPlane(Origin=Point(0, 0, 0))
rectangle_3 = Rectangle(Plane=xy_3, XSize=Slider(39, range=0..100), YSize=Slider(26, range=0..100), Radius=Slider(38, range=0..100))  # -> Rectangle, Length

# ---- group: Loft Geometry
geometry = Geometry([rectangle.Rectangle, rectangle_2.Rectangle, rectangle_3.Rectangle])
loft = Loft(Curves=geometry, Options={Adjust=False, Closed=False, LoftEnds=0, LoftSimp=0, LoftType=0, Rebuild=10, Refit=0.01})

# ---- group: Cap and Discretize as Mesh
cap = CapHoles(Brep=loft)
mesh = MeshBrep(
    Brep=cap,
    Settings={GridMaxCount=0, GridMinCount=16, JaggedSeams=False, MaxEdgeLength=0, MinEdgeLength=0.0001, MinTolerance=0, Refine=True, RefineAngle=0, RelativeTolerance=0.65, SimplePlanes=True, Tolerance=0})
