# Grasshopper definition GHTwistRectsBBox.gh (Grasshopper 1.0.7)

number_slider = Slider(5, range=0..10)
number_slider_2 = Slider(6, range=0..10)
series = Series(Start=0, Step=number_slider, Count=number_slider_2)
unit_z = UnitZ(Factor=series)
panel = Panel(series)
point = Point(unit_z)
panel_2 = Panel(unit_z)
series_2 = Series(Start=Slider(10, range=10..100), Step=Slider(6, range=0..15), Count=number_slider_2)
xy_plane = XYPlane(Origin=point)
rectangle = Rectangle(Plane=xy_plane, XSize=Domain(-1, 1), YSize=series_2, Radius=0)  # -> Rectangle, Length
unit_z_2 = UnitZ(Factor=number_slider)
surface = Surface(rectangle.Rectangle)
extrude = Extrude(Base=surface, Direction=unit_z_2)
solid_union = SolidUnion(Breps=extrude)
bounding_box = BoundingBox(Content=solid_union, Plane=PlaneXY(0, 0, 0))  # -> Box, Box_2
area = Area(Geometry=solid_union)  # -> Area, Centroid
deconstruct_box = DeconstructBox(Box=bounding_box.Box)  # -> Plane, X, Y, Z
deconstruct_domain = DeconstructDomain(Domain=deconstruct_box.Z)  # -> Start, End
