# Grasshopper definition RSPoint.gh (Grasshopper 1.0.7)

python = GhPythonScript(x=Slider(6, range=0..10), y=Slider(6, range=0..10))  # -> out, a, d
# ---------- python: Python ----------
__author__ = "mrivera-cu"

import rhinoscriptsyntax as rs

a = rs.AddPoint((x,y,5))
print(a)
# ---------- end python ----------
panel = Panel(python.out)
