# Grasshopper definition SimulateBallDrop.gh (Grasshopper 1.0.7)
# plug-ins: Kangaroo2 Components

# ---- group: CREATE MESH SPHERE
startz = Slider(15, range=0..30)
starty = Slider(0, range=0..30)
startx = Slider(0, range=0..30)
vector_xyz = VectorXYZ(XComponent=startx, YComponent=starty, ZComponent=startz)  # -> Vector, Length
mesh_sphere = MeshSphere(Base=vector_xyz.Vector, Radius=Slider(3, range=0..50), UCount=10, VCount=20)

# ---- group: Gravity
vertexloads = VertexLoads(Mesh=mesh_sphere, Strength=Slider(-1e-05, range=-0.5..-1e-05))

# ---- group: Combine Goals
entwine = Entwine(Branch00=vertexloads, FlattenInputs=True)

# ---- group: Simulate
solver = Solver(GoalObjects=entwine, Reset=Button(), Threshold=1e-15, Tolerance=0.0001, On=Toggle(True))  # -> I, V, O
