# Grasshopper definition SimulateBallDropFloor.gh (Grasshopper 1.0.7)
# plug-ins: Kangaroo2 Components

# ---- group: CREATE MESH SPHERE
startz = Slider(15, range=0..30)
starty = Slider(0, range=0..30)
startx = Slider(0, range=0..30)
vector_xyz = VectorXYZ(XComponent=startx, YComponent=starty, ZComponent=startz)  # -> Vector, Length
mesh_sphere = MeshSphere(Base=vector_xyz.Vector, Radius=Slider(3, range=0..50), UCount=10, VCount=20)

# ---- group: Gravity
vertexloads = VertexLoads(Mesh=mesh_sphere, Strength=Slider(-9.8, range=-9.8..0))

# ---- group: Floor
floor = Floor(Strength=Slider(1000, range=0..1000))

# ---- group: CREATE SPRINGS BETWEEN ALL POINTS IN SPHERE
deconstruct_mesh = DeconstructMesh(Mesh=mesh_sphere)  # -> Vertices, Faces, Colours, Normals
interconnectpoints = InterconnectPoints(Pts=deconstruct_mesh.Vertices)
removeduplicatelines = RemoveDuplicateLines(Lines=interconnectpoints, Tolerance=0.01)
list_length = ListLength(List=removeduplicatelines)
division = Division(A=list_length, B=Slider(624, range=0..10000))
length_line = LengthLine(Line=removeduplicatelines, Strength=division)

# ---- group: THE MESH GEOMETRY TO SHOW
# Simulation Goals
show = Show(G=mesh_sphere)

# ---- group: COMBINE ALL GOALS
entwine = Entwine(Branch00=show, Branch01=floor, Branch02=vertexloads, Branch03=length_line, FlattenInputs=True)

# ---- group: RUN SIMULATION
solver = Solver(GoalObjects=entwine, Reset=Button(), Threshold=1e-15, Tolerance=0.0001, On=Toggle(False))  # -> I, V, O
explode_tree = ExplodeTree(Data=solver.O)  # -> Branch0, Branch1, Branch2, Branch3
output_mesh = Geometry(explode_tree.Branch0)
